# Grasshopper definition GCodeImporter.gh (Grasshopper 0.9.76)
# plug-ins: HAL for Grasshopper

# ---- group: Import targets and instructions. If you only want the targets stop here.
panel = Panel("Path\To\GCode\File.gcode")
parser = GCodeParser(Path=panel, Scale=1, _0_0=panel, Mode=0, nickName="Parser", RunInBackground=False)  # -> Object_Instruction, Object_Target

# ---- group: Replace a feed rate with Speed Settings
number_slider = Slider(120, range=0..1000)
speed = SpeedSettings(Position=number_slider, _1_0=number_slider, Mode=0, nickName="Speed", RunInBackground=False)
panel_2 = Panel("12000")
speed_2 = ReplaceSpeed(FeedRate=panel_2, Speed=speed, _0_0=panel_2, _1_0=speed, Mode=0, nickName="Speed", RunInBackground=False)

number_slider_2 = Slider(1000, range=0..1000)
speed_3 = SpeedSettings(Position=number_slider_2, _1_0=number_slider_2, Mode=0, nickName="Speed", RunInBackground=False)
panel_3 = Panel("60000")
speed_4 = ReplaceSpeed(FeedRate=panel_3, Speed=speed_3, _0_0=panel_3, _1_0=speed_3, Mode=0, nickName="Speed", RunInBackground=False)

# ---- group: Replace an exact code with a pattern with replacement rules for parameters
panel_4 = Panel("\"SetToolSpeed(\"<T>\",\"sqrt(<S>/100*2.5)*pi\")\"\";\"")
panel_5 = Panel("M109")
pattern = ReplacePattern(Match=panel_5, Pattern=panel_4, _0_0=panel_5, _1_0=panel_4, Mode=0, nickName="Pattern", RunInBackground=False)

# ---- group: Replace a range of G codes with a custom action
panel_6 = Panel("\"DoSomething()\"")
number_slider_3 = Slider(225, range=0..1000)
number_slider_4 = Slider(230, range=0..1000)
custom = CustomAction(Alias="Custom Action", Expression=panel_6, _1_0=panel_6, Mode=0, nickName="Custom", RunInBackground=False)
range = ReplaceRange(
    From=number_slider_3,
    To=number_slider_4,
    Replacement=custom,
    _0_0=number_slider_3,
    _1_0=number_slider_4,
    _2_0=custom,
    Mode=0,
    nickName="Range",
    RunInBackground=False)

# ---- group: Replace exact code with a custom action
panel_7 = Panel("\"ChangeTool\"")
custom_2 = CustomAction(Alias="Custom Action", Expression=panel_7, _1_0=panel_7, Mode=0, nickName="Custom", RunInBackground=False)
panel_8 = Panel("M106")
match = ReplaceMatch(Match=panel_8, Replacement=custom_2, _0_0=panel_8, _1_0=custom_2, Mode=0, nickName="Match", RunInBackground=False)

# ---- group: Replace any occurence of an argument with a new instruction
panel_9 = Panel("\"SetCurrentToolSpeed(\"<E>+12\")\"\";\"")
panel_10 = Panel("E")
argument = ReplaceArgument(Argument=panel_10, Pattern=panel_9, _0_0=panel_10, _1_0=panel_9, Mode=0, nickName="Argument", RunInBackground=False)

# ---- group: Subset to speed up rules testing
subset = SubList(List=parser.Object_Instruction, Domain=Slider(235, range=0..1000), Wrap=False)  # -> List, Index

# ----
merge = Merge(
    Data1=flatten(argument),
    Data2=flatten(speed_2),
    Data3=flatten(speed_4),
    Data4=flatten(pattern),
    Data5=flatten(range),
    Data6=flatten(match))

interpreter = GCodeInterpreter(
    Object_Instruction=subset.List,
    Object_Rule=merge,
    _0_0=subset,
    _1_0=merge,
    Mode=0,
    nickName="Interpreter",
    RunInBackground=False)
importedprocedure = Procedure(interpreter)
importedtargets = Target(parser.Object_Target)
