# Grasshopper definition URDemo.gh (Grasshopper 1.0.7)
# plug-ins: HAL for Grasshopper

sessionsettings = SessionSettings()

panel = Panel("2")
doutput = DigitalOutput(
    Alias=panel,
    LowV=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,
    HighV=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,
    Default=False,
    _0_0=panel,
    Mode=0,
    RunInBackground=False,
    nickName="DOutput")

pt = ConstructPoint(XCoordinate="600", YCoordinate="-50", ZCoordinate="-30")
xy = XYPlane(Origin=pt)
rotate = Rotate(Geometry=xy, Angle=degrees(Slider(0, range=-180..80)), Plane=xy)  # -> Geometry, Transform
panel_2 = Panel("Table")
reference = CreateReference(Alias=panel_2, Frame=rotate.Geometry, _0_0=panel_2, _1_0=rotate, Mode=0, RunInBackground=False, nickName="Reference")

_2 = _2(doutput, isNickNameImplied=True)
panel_3 = Panel("Cone")
table = Table(reference, isNickNameImplied=True)

# ---- group: FollowCurveOrientedTowardsRobot
number_slider = Slider(15, range=0..100)
crv = Curve(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)
target = Target(
    Alias="Curve",
    Curve=crv,
    Discretization={halEnum=1, halEnumType="HAL.McNeel.RhinoCommon5.Spatial.CurveDiscretization"},
    ToleranceMm=number_slider,
    InWorld=True,
    _1_0=crv,
    _3_0=number_slider,
    Mode=0,
    RunInBackground=False,
    nickName="Target")  # -> Object_Target, Trace
target_2 = TargetProperties(Target=target.Object_Target, _0_0=target, Mode=0, RunInBackground=False, nickName="Target")  # -> Alias, Object_Joint, WayFrame, EndFrame, Reference, IsArc
xy_2 = XYPlane(Origin=Point(0, 0, 0))
vec2pt = Vector2Pt(PointA=xy_2, PointB=target_2.EndFrame, Unitize=False)  # -> Vector, Length
parallel = Parallel(
    Target=target.Object_Target,
    Direction=vec2pt.Vector,
    Axis={halEnum=0, halEnumType="HAL.Spatial.Axis"},
    Flip=True,
    Project=False,
    _0_0=target,
    _2_0=vec2pt,
    Mode=0,
    RunInBackground=False,
    nickName="Parallel")
move = Move(Object_Target=parallel, _1_0=parallel, Mode=0, RunInBackground=False, nickName="Move")

# ---- group: FollowCurveOnReference
number_slider_2 = Slider(10, range=0..10)
number_slider_3 = Slider(360, range=0..1000)
number_slider_4 = Slider(15, range=0..100)
cir = Circle(Plane=PlaneXY(0, 0, 0), Radius=Slider(200, range=0..1000))
speed = SpeedSettings(PositionMmS=number_slider_3, _1_0=number_slider_3, Mode=0, RunInBackground=False, nickName="Speed")
blend = BlendSettings(PositionMm=number_slider_2, _1_0=number_slider_2, Mode=0, RunInBackground=False, nickName="Blend")
table_2 = Table(table, isNickNameImplied=True)
crv_2 = Curve(cir)
target_3 = Target(
    Alias="Curve",
    Curve=crv_2,
    Discretization={halEnum=1, halEnumType="HAL.McNeel.RhinoCommon5.Spatial.CurveDiscretization"},
    ToleranceMm=number_slider_4,
    Reference=table_2,
    InWorld=False,
    _1_0=crv_2,
    _3_0=number_slider_4,
    _4_0=table_2,
    Mode=0,
    RunInBackground=False,
    nickName="Target")  # -> Object_Target, Trace
motionsettings = MotionSettings(
    Space={halEnum=0, halEnumType="HAL.Motion.Settings.MotionSpace"},
    Speed=speed,
    Blend=blend,
    _2_0=speed,
    _4_0=blend,
    Mode=0,
    RunInBackground=False,
    nickName="MotionSettings")
move_2 = Move(
    Object_Target=target_3.Object_Target,
    Object_MotionSettings=motionsettings,
    _1_0=target_3,
    _2_0=motionsettings,
    Mode=0,
    RunInBackground=False,
    nickName="Move")
crv_3 = Curve(target_3.Trace)

# ---- group: Wait Time
number_slider_5 = Slider(0.5, range=0..1)
wait = WaitTime(Alias="Wait", DurationS=number_slider_5, _1_0=number_slider_5, Mode=0, RunInBackground=False, nickName="Wait")

# ---- group: Reset Signal
toggle = BooleanToggle(False)
_2_2 = _2(_2, isNickNameImplied=True)
signal = SetDigitalOutputSignal(
    Signal=_2_2,
    Effect={halEnum=1, halEnumType="HAL.Procedures.Actions.SignalEffect"},
    State=toggle,
    _1_0=_2_2,
    _3_0=toggle,
    Mode=0,
    RunInBackground=False,
    nickName="Signal")

# ---- group: Set Signal
toggle_2 = BooleanToggle(True)
_2_3 = _2(_2, isNickNameImplied=True)
signal_2 = SetDigitalOutputSignal(
    Signal=_2_3,
    Effect={halEnum=1, halEnumType="HAL.Procedures.Actions.SignalEffect"},
    State=toggle_2,
    _1_0=_2_3,
    _3_0=toggle_2,
    Mode=0,
    RunInBackground=False,
    nickName="Signal")

# ----
_2_4 = _2(_2, isNickNameImplied=True)
panel_4 = Panel("CB3")
monitor = Monitor(False)

cone = Cone(Base=PlaneXY(0, 0, 0), Radius=Slider(30, range=0..100), Length=Slider(200, range=0..1000))  # -> Cone, Tip
xy_3 = XYPlane(Origin=cone.Tip)

mesh = MeshBrep(
    Brep=cone.Cone,
    Settings={GridMaxCount=0, GridMinCount=16, JaggedSeams=False, MaxEdgeLength=0, MinEdgeLength=0.0001, MinTolerance=0, Refine=True, RefineAngle=0, RelativeTolerance=0.65, SimplePlanes=True, Tolerance=0})
xy_4 = XYPlane(Origin=Point(0, 0, 0))
robot = Robot(
    Alias="Robot",
    Mode=0,
    RunInBackground=False,
    catalogItem="Mechanism,da0f70f5-3c79-4478-b689-cac5063b3af8",
    nickName="⧉ Robot")

tool = Tool(
    Alias=panel_3,
    Frame=xy_4,
    Object_Body=mesh,
    ToolFrame=xy_3,
    _0_0=panel_3,
    _1_0=xy_4,
    _2_0=mesh,
    _6_0=xy_3,
    Mode=0,
    RunInBackground=False,
    nickName="Tool")

attach = Attach(
    Alias="Composite Mechanism",
    Parent=robot,
    Child=tool,
    IsEndEffector=True,
    Location=Plane(origin=(-1.234321012e+308, -1.234321012e+308, -1.234321012e+308), x=(0, 0, 0), y=(0, 0, 0)),
    InWorld=True,
    _1_0=robot,
    _2_0=tool,
    Mode=0,
    RunInBackground=False,
    nickName="Attach")

compositemechanism = CompositeMechanism(attach, isNickNameImplied=True)

# ---- group: JointMove
acceleration = AccelerationSettings(Mode=0, RunInBackground=False, nickName="Acceleration")
speed_2 = SpeedSettings(Mode=0, RunInBackground=False, nickName="Speed")
blend_2 = BlendSettings(Mode=0, RunInBackground=False, nickName="Blend")
compositemechanism_2 = CompositeMechanism(compositemechanism, isNickNameImplied=True)
merge = Merge(
    Data1=Slider(13, range=-180..180),
    Data2=Slider(-104, range=-180..180),
    Data3=Slider(-72, range=-180..180),
    Data4=Slider(-119, range=-180..180),
    Data5=Slider(86, range=-180..180),
    Data6=Slider(0, range=-180..180))  # -> flatten(Result)
space = Space({halEnum=1, halEnumType="HAL.Motion.Settings.MotionSpace"}, EnumerationType="MotionSpace", isNickNameImplied=True)
rad = Radians(Degrees=merge)
motionsettings_2 = MotionSettings(
    Space=space,
    Speed=speed_2,
    Acceleration=acceleration,
    Blend=blend_2,
    _1_0=space,
    _2_0=speed_2,
    _3_0=acceleration,
    _4_0=blend_2,
    Mode=0,
    RunInBackground=False,
    nickName="MotionSettings")
target_4 = Target(
    Mechanism=compositemechanism_2,
    Object_Position=rad,
    _1_0=compositemechanism_2,
    _2_0=rad,
    Mode=0,
    RunInBackground=False,
    nickName="Target")
move_3 = Move(
    Object_Target=target_4,
    Object_MotionSettings=motionsettings_2,
    _1_0=target_4,
    _2_0=motionsettings_2,
    Mode=0,
    RunInBackground=False,
    nickName="Move")

compositemechanism_3 = CompositeMechanism(compositemechanism, isNickNameImplied=True)
merge_2 = Merge(
    Data1=Slider(15, range=-180..180),
    Data2=Slider(-103, range=-180..180),
    Data3=Slider(-67, range=-180..180),
    Data4=Slider(-78, range=-180..180),
    Data5=Slider(98, range=-180..180),
    Data6=Slider(0, range=-180..180))  # -> flatten(Result)
rad_2 = Radians(Degrees=merge_2)
target_5 = Target(
    Mechanism=compositemechanism_3,
    Object_Position=rad_2,
    _1_0=compositemechanism_3,
    _2_0=rad_2,
    Mode=0,
    RunInBackground=False,
    nickName="Target")
motionsettings_3 = MotionSettings(
    Space={halEnum=1, halEnumType="HAL.Motion.Settings.MotionSpace"},
    Mode=0,
    RunInBackground=False,
    nickName="MotionSettings")
move_4 = Move(
    Object_Target=target_5,
    Object_MotionSettings=motionsettings_3,
    _1_0=target_5,
    _2_0=motionsettings_3,
    Mode=0,
    RunInBackground=False,
    nickName="Move")

# ----
merge_3 = Merge(
    Data1=flatten(move_3),
    Data2=flatten(move),
    Data3=flatten(signal_2),
    Data4=flatten(wait),
    Data5=flatten(signal),
    Data6=flatten(move_2),
    Data7=flatten(move_4))
combine = CombineActions(Object_Combined=merge_3, Compact=True, _1_0=merge_3, Mode=0, RunInBackground=False, nickName="Combine")
compositemechanism_4 = CompositeMechanism(compositemechanism, isNickNameImplied=True)
controller = Controller(
    Alias=panel_4,
    Object_Mechanism=compositemechanism_4,
    Object_Procedure=combine,
    Object_Signal=_2_4,
    _0_0=panel_4,
    _2_0=compositemechanism_4,
    _3_0=combine,
    _4_0=_2_4,
    Mode=0,
    RunInBackground=False,
    catalogItem="Controller,83976cb8-32d3-4880-8a71-a5169cecf7ec",
    nickName="⧉ Controller")
solve = Solve(Object_Controller=controller, Solve=Toggle(False), Mode=0, RunInBackground=True)  # -> Solution, Solved, Notification

execution_control = ExecutionControl(Loop=False, TimeRatio=1)
execute = Execute(
    ExecutionControl=execution_control,
    Solution=solve.Solution,
    Monitor=monitor,
    displayEnvironment=True,
    displayMechanisms=True,
    displayTrace=True,
    useRealTime=True)

panel_5 = Panel("C:\HAL\URScript")
export = BooleanToggle(False)
export_2 = ExportProcedure(
    Controller=controller,
    Solution=solve.Solution,
    Mode={halEnum=0, halEnumType="HAL.Linguistics.Export.DeclarationMode"},
    Destination=panel_5,
    Export=export,
    _0_0=controller,
    _1_0=solve,
    _4_0=panel_5,
    _5_0=export,
    RunInBackground=True,
    nickName="Export")
